# Dynamo graph TapiocaRoundTripTest.dyn "Tapioca Round Trip Test" (Dynamo 4.2.1.5887)
# author: Tapioca
# Manual Tapioca round-trip test. Select one element in Archicad's 3D window, Run once with Apply false, then toggle Apply true and Run once. Translation values are metres.

how_to_test = CodeBlock()
# ---------- how_to_test.designscript (8 lines) ----------
/*
1. Select one element in Archicad's 3D window.
2. Keep Apply false and Run once to capture and preview the target.
3. Toggle Apply true and Run once to write.
4. Toggle Apply false and Run to re-arm. Re-applying an unchanged target must be a no-op.

Tapir supports XYZ. Tapioca supports Z only. Values are metres.
*/;
# ----------------------------------------
body_index = IntegerSlider(0, range=0..100 step 1)  # graph input
refresh_selection = BoolSelector(false)  # graph input
current_3d_body = Tapioca.Geometry.CurrentSelectionBody(index=body_index, refresh=refresh_selection)
dx_metres = DoubleInput(0.25)  # graph input
dy_metres = DoubleInput(0)  # graph input
dz_metres = DoubleInput(0)  # graph input
staged_target_preview = Tapioca.Geometry.Translate(mesh=current_3d_body, dx=dx_metres, dy=dy_metres, dz=dz_metres)
backend = StringInput("Tapir")  # graph input
apply_false_then_true = BoolSelector(false)  # graph input
apply_target = Tapioca.Elements.ApplyTranslation(original=current_3d_body, modified=staged_target_preview, backend=backend, apply=apply_false_then_true)
result = Watch(apply_target.message)
